# Grasshopper definition 台阶类.gh (Grasshopper 1.0.8)
# plug-ins: RhinoCodePluginGH, Bifocals

curve = Curve(<curve referenced from the Rhino model>)
curve_2 = Curve(<curve referenced from the Rhino model>)
merge = Merge(Data1=Slider(50, range=0..100), Data2="x", Data3=Slider(50, range=0..100))
text_join = TextJoin(Text=merge)
panel = Panel(text_join)
creat_step = CreatStep(
    scale="900X350X150",
    light=text_join,
    start=curve,
    end=curve_2,
    width=Slider(500, range=0..1000),
    length=[Slider(3951, range=0..10000), Slider(2500, range=0..10000), Slider(1500, range=0..10000)],
    height=Slider(100, range=0..100),
    step=Slider(6, range=0..10),
    gc=Slider(6475, range=0..10000))  # -> out, step; inputs length: list
# ---------- creat_step: Python ----------
__author__ = "Mai"
__version__ = "2024.07.15"

ghenv.Component.Name = 'creat step'
ghenv.Component.NickName = 'creat step'
ghenv.Component.Description = '创建台阶'
ghenv.Component.Message = '0.0.1'
ghenv.Component.Category = 'Magic'
ghenv.Component.SubCategory = 'test1'
ghenv.Component.AdditionalHelpFromDocStrings = '1'


import rhinoscriptsyntax as rs 


class lastep:
    def __init__(self,start,end,width,length,height,step,location=(0,0,0)):
        self.start=start
        self.end=end
        self.width=width
        self.length=length
        self.height=height
        self.step=step
        self.location=location
    
    # 台阶剖面
    def creat_step_profile(self,scale,light='50x50'):
    
        scale=scale.upper()
        p_length,p_width,p_height = scale.split('X')

        p_plane = rs.PlaneFromPoints((0,0,0),(0,1,0),(0,1,1))
        srf = rs.AddPlanarSrf(rs.AddRectangle(p_plane,int(p_width),int(p_height)))
        
        if light:

            light=light.upper()
            l_width,l_height = light.split('X')

            light_srf = rs.AddPlanarSrf(rs.AddRectangle(p_plane,int(l_width),int(l_height)))
            fina_srf = rs.BooleanDifference(srf,light_srf)
            return fina_srf
        else:
            return srf


    # 通过平移，得到完整的台阶
    def creat_step_gc(self,GC):
        objs=[]
        if GC%150 == 0:
            step_num = GC//150
        else:
            step_num = GC//150 +1
        for i in range(int(step_num)):
            # 创建移动向量
            from_point=(0,0,0)
            to_point=(0,self.width*i,150*i)
            trans = rs.VectorCreate(to_point, from_point)
            # 获得移动后的台阶
            obj = rs.MoveObject(self.creat_step_profile(scale,light),trans)

            # 创建台阶长度向量
            pt_strat = rs.AddPoint((0,0,0))

            pt_end = rs.AddPoint((self.length[i%len(self.length)],0,0))
            # 获得台阶体
            step= rs.ExtrudeSurface(obj, rs.AddLine(pt_strat,pt_end))
            objs.append(step)
        return objs

    def cut_edge(self,polyline):
        if polyline:
            for i in self.creat_step:
                rs.SplitBrep(i,polyline)
                



test = lastep(start,end,width,length,height,step,location)
step = test.creat_step_gc(gc)
# ---------- end creat_step ----------
