# Grasshopper definition 座椅.gh (Grasshopper 1.0.8)
# plug-ins: RhinoCodePluginGH, Bifocals

# ---- group: 制作座椅刻度线
# 制作座椅刻度线
curve = Curve(<curve referenced from the Rhino model>)
offset_curve = OffsetCurve(Curve=curve, Distance=expr("-x", Slider(20, range=0..100)), Corners=1)
extend_curve = ExtendCurve(Curve=offset_curve, Type=0, Start=expr("-X", Slider(200, range=0..1000)), End=expr("-X", Slider(400, range=0..10000)))
divide_curve = DivideCurve(Curve=extend_curve, Count=Slider(10, range=0..10), Kinks=False)  # -> Points, Tangents, Parameters
curve_frame = CurveFrame(Curve=offset_curve, Parameter=divide_curve.Parameters)
center_box = CenterBox(Base=curve_frame, X=Slider(10, range=0..100), Y=Slider(100, range=0..100), Z=Slider(0, range=0..100))
deconstruct_brep = DeconstructBrep(Brep=center_box)  # -> Faces, Edges, Vertices
surface_split = SurfaceSplit(Surface=deconstruct_brep.Faces, Curves=offset_curve)
list_item = ListItem(List=surface_split, Index=0, Wrap=True)
curve_2 = Curve(deconstruct_brep.Faces)
deconstruct_brep_2 = DeconstructBrep(Brep=list_item)  # -> Faces, Edges, Vertices
trim_with_regions = TrimWithRegions(Curve=offset_curve, Regions=flatten(curve_2))  # -> Inside, Outside
cull_index = CullIndex(List=deconstruct_brep_2.Edges, Indices=Slider(2, range=0..10), Wrap=True)
curve_3 = Curve(trim_with_regions.Outside)
merge = Merge(Data1=flatten(curve_3), Data2=flatten(cull_index))
join_curves = JoinCurves(Curves=merge, Preserve=False)
panel = Panel(join_curves)

# ----
curve_4 = Curve([<curve referenced from the Rhino model> x11])
surface = Surface(curve_4)
deconstruct_brep_3 = DeconstructBrep(Brep=surface)  # -> Faces, Edges, Vertices
python_3_script = Python3Script(edges=deconstruct_brep_3.Edges)  # -> out, a; inputs edges: list
# ---------- python_3_script: Python ----------
import rhinoscriptsyntax as rs 
for i in edges:
    if rs.IsLine(i):
        print(1)
    else:
        print(0)
# ---------- end python_3_script ----------
equality = Equality(FirstNumber=python_3_script.out, SecondNumber=Slider(1, range=0..1))  # -> Equality, Inequality
dispatch = Dispatch(List=deconstruct_brep_3.Edges, DispatchPattern=equality.Equality)  # -> ListA, ListB

# ---- group: 文字刻字
# 制作座椅表面文字刻字
curve_5 = Curve(<curve referenced from the Rhino model>)
divide_distance = DivideDistance(Curve=curve_5, Distance=Slider(300, range=0..1000))  # -> Points, Tangents, Parameters
shatter = Shatter(Curve=curve_5, Parameters=divide_distance.Parameters)
list_item_2 = ListItem(List=shatter, Index=0, Wrap=True)
end_points = EndPoints(Curve=list_item_2)  # -> Start, End
curve_middle = CurveMiddle(Curve=list_item_2)
line = Line(StartPoint=end_points.Start, EndPoint=end_points.End)
panel_2 = Panel(shatter)
circle = Circle(Plane=curve_middle, Radius=Slider(100, range=0..1000))
offset_curve_2 = OffsetCurve(Curve=circle, Distance=expr("-x", Slider(20, range=0..100)), Corners=1)
unit_z = UnitZ(Factor=Slider(100, range=0..100))
pi = Pi(Factor=1)
textsrf = TextOnSurface(
    Text="A",
    Font="arial",
    Height=Slider(100, range=0..1000),
    Depth=Slider(0, range=0..1000),
    BaseLine=list_item_2,
    BaseSurface=circle)
extrude = Extrude(Base=line, Direction=unit_z)
rotate_axis = RotateAxis(Geometry=extrude, Angle=expr("1/2*X", pi), Axis=line)  # -> Geometry, Transform
plane = Plane(extrude)
plane_2 = Plane(rotate_axis.Geometry)
orient = Orient(Geometry=textsrf, Source=plane, Target=plane_2)  # -> Geometry, Transform
deconstruct_brep_4 = DeconstructBrep(Brep=orient.Geometry)  # -> Faces, Edges, Vertices
curve_6 = Curve(deconstruct_brep_4.Edges)
join_curves_2 = JoinCurves(Curves=curve_6, Preserve=False)
merge_2 = Merge(Data1=circle, Data2=offset_curve_2)
panel_3 = Panel(join_curves_2)

# ----
join_curves_3 = JoinCurves(Curves=dispatch.ListB, Preserve=False)
number_slider = Slider(10, range=0..10)
list_item_3 = ListItem(List=join_curves_3, Index=Slider(1, range=0..1), Wrap=True)  # -> flatten(Item)
list_item_4 = ListItem(List=join_curves_3, Index=Slider(0, range=0..1), Wrap=True)  # -> flatten(Item)
list_item_5 = ListItem(List=list_item_3, Index=number_slider, Wrap=True)
list_item_6 = ListItem(List=list_item_4, Index=number_slider, Wrap=True)
replace_items = ReplaceItems(List=list_item_4, Item=list_item_5, Indices=number_slider, Wrap=False)
replace_items_2 = ReplaceItems(List=list_item_3, Item=list_item_6, Indices=number_slider, Wrap=False)
data = Data(flatten(dispatch.ListA))
number_slider_2 = Slider(5, range=0..10)
number_slider_3 = Slider(0, range=0..10)
number_slider_4 = Slider(4, range=0..10)
merge_3 = Merge(Data1=data, Data2=replace_items)  # -> flatten(Result)
list_item_7 = ListItem(List=replace_items_2, Index=number_slider_3, Wrap=True)
list_item_8 = ListItem(List=replace_items_2, Index=number_slider_4, Wrap=True)
list_item_9 = ListItem(List=replace_items_2, Index=number_slider_2, Wrap=True)
join_curves_4 = JoinCurves(Curves=merge_3, Preserve=False)
merge_4 = Merge(Data1=list_item_7, Data2=list_item_8, Data3=list_item_9)
merge_5 = Merge(Data1=number_slider_3, Data2=number_slider_4, Data3=number_slider_2)
flip_curve = FlipCurve(Curve=merge_4)  # -> Curve, Flag
replace_items_3 = ReplaceItems(List=replace_items_2, Item=flip_curve.Curve, Indices=merge_5, Wrap=False)
flip_curve_2 = FlipCurve(Curve=replace_items_3)  # -> Curve, Flag
unit_z_2 = UnitZ(Factor=Slider(450, range=0..1000))
extend_curve_2 = ExtendCurve(Curve=flip_curve_2.Curve, Type=0, Start=expr("-x", 300), End=0)

unit_z_3 = UnitZ(Factor=Slider(450, range=0..1000))
end_points_2 = EndPoints(Curve=extend_curve_2)  # -> Start, End
divide_distance_2 = DivideDistance(Curve=extend_curve_2, Distance=Slider(75, range=0..1000))  # -> Points, Tangents, Parameters
unit_z_4 = UnitZ(Factor=Slider(10, range=0..100))
extrude_2 = Extrude(Base=end_points_2.Start, Direction=expr("-x", unit_z_3))
shatter_2 = Shatter(Curve=graft(extend_curve_2), Parameters=divide_distance_2.Parameters)
list_item_10 = ListItem(List=shatter_2, Index=0, Wrap=True)
extrude_3 = Extrude(Base=list_item_10, Direction=expr("-x", unit_z_4))
divide_curve_2 = DivideCurve(Curve=extrude_2, Count=10, Kinks=False)  # -> Points, Tangents, Parameters
line_2 = Line(StartPoint=graft(end_points_2.Start), EndPoint=divide_curve_2.Points)
length = Length(Curve=line_2)
unit_z_5 = UnitZ(Factor=length)
move = Move(Geometry=extrude_3, Motion=expr("-x", unit_z_5))  # -> Geometry, Transform

divide_distance_3 = DivideDistance(Curve=extend_curve_2, Distance=Slider(25, range=0..1000))  # -> Points, Tangents, Parameters
curve_frame_2 = CurveFrame(Curve=graft(extend_curve_2), Parameter=divide_distance_3.Parameters)
list_item_11 = ListItem(List=curve_frame_2, Index=0, Wrap=True)
cull_index_2 = CullIndex(List=move.Geometry, Indices=Slider(10, range=0..10), Wrap=True)
shatter_3 = Shatter(Curve=graft(extend_curve_2), Parameters=divide_distance_3.Parameters)
list_item_12 = ListItem(List=shatter_3, Index=0, Wrap=True)
extrude_4 = Extrude(Base=list_item_12, Direction=expr("-x", unit_z_2))
deconstruct_plane = DeconstructPlane(Plane=list_item_11)  # -> Origin, XAxis, YAxis, ZAxis
amplitude = Amplitude(Vector=deconstruct_plane.YAxis, Amplitude=Slider(1, range=0..100))

# ---- group: 文字刻字
curve_7 = Curve(extend_curve_2)
divide_distance_4 = DivideDistance(Curve=curve_7, Distance=Slider(600, range=0..1000))  # -> Points, Tangents, Parameters
shatter_4 = Shatter(Curve=graft(curve_7), Parameters=divide_distance_4.Parameters)
list_item_13 = ListItem(List=shatter_4, Index=0, Wrap=True)
end_points_3 = EndPoints(Curve=list_item_13)  # -> Start, End
panel_4 = Panel(shatter_4)
line_3 = Line(StartPoint=end_points_3.Start, EndPoint=end_points_3.End)
number_slider_5 = Slider(4, range=0..1000)
curve_middle_2 = CurveMiddle(Curve=line_3)
curve_middle_3 = CurveMiddle(Curve=list_item_13)
flip_curve_3 = FlipCurve(Curve=list_item_13)  # -> Curve, Flag
line_4 = Line(StartPoint=curve_middle_3, EndPoint=curve_middle_2)
textsrf_2 = TextOnSurface(Text="0mm", Font="arial", Height=Slider(100, range=0..1000), Depth=number_slider_5, BaseLine=flip_curve_3.Curve)
pi_2 = Pi(Factor=1)
rotate_axis_2 = RotateAxis(Geometry=textsrf_2, Angle=pi_2, Axis=line_4)  # -> Geometry, Transform
unit_z_6 = UnitZ(Factor=Slider(380, range=0..1000))
move_2 = Move(Geometry=rotate_axis_2.Geometry, Motion=expr("-x", unit_z_6))  # -> Geometry, Transform

# ----
unit_z_7 = UnitZ(Factor=Slider(450, range=0..1000))

# ---- group: 文字刻字
curve_8 = Curve(extend_curve_2)
divide_distance_5 = DivideDistance(Curve=curve_8, Distance=Slider(600, range=0..1000))  # -> Points, Tangents, Parameters
shatter_5 = Shatter(Curve=graft(curve_8), Parameters=divide_distance_5.Parameters)
list_item_14 = ListItem(List=shatter_5, Index=0, Wrap=True)
end_points_4 = EndPoints(Curve=list_item_14)  # -> Start, End
panel_5 = Panel(shatter_5)
line_5 = Line(StartPoint=end_points_4.Start, EndPoint=end_points_4.End)
curve_middle_4 = CurveMiddle(Curve=line_5)
curve_middle_5 = CurveMiddle(Curve=list_item_14)
flip_curve_4 = FlipCurve(Curve=list_item_14)  # -> Curve, Flag
line_6 = Line(StartPoint=curve_middle_5, EndPoint=curve_middle_4)
textsrf_3 = TextOnSurface(Text="450mm", Font="arial", Height=Slider(100, range=0..1000), Depth=number_slider_5, BaseLine=flip_curve_4.Curve)
pi_3 = Pi(Factor=1)
rotate_axis_3 = RotateAxis(Geometry=textsrf_3, Angle=pi_3, Axis=line_6)  # -> Geometry, Transform
unit_z_8 = UnitZ(Factor=Slider(80, range=0..1000))
move_3 = Move(Geometry=rotate_axis_3.Geometry, Motion=expr("-x", unit_z_8))  # -> Geometry, Transform

# ----
unit_z_9 = UnitZ(Factor=Slider(450, range=0..1000))
extrude_5 = Extrude(Base=extrude_4, Direction=amplitude)
extrude_6 = Extrude(Base=cull_index_2, Direction=amplitude)
extrude_7 = Extrude(Base=join_curves_4, Direction=expr("-x", unit_z_7))
extrude_8 = Extrude(Base=flip_curve_2.Curve, Direction=expr("-x", unit_z_9))
solid_union = SolidUnion(Breps=flatten([extrude_5, extrude_6]))
merge_6 = Merge(Data1=move_2.Geometry, Data2=move_3.Geometry)  # -> flatten(Result)
data_dam = DataDam(DataA=merge_6, BufferDelay=10000000, BufferMode=0)
solid_union_2 = SolidUnion(Breps=flatten([data_dam, extrude_8]))
solid_union_3 = SolidUnion(Breps=flatten([solid_union, solid_union_2]))
brep_join = BrepJoin(Breps=flatten([extrude_7, surface, solid_union_3]))  # -> Breps, Closed
