# Grasshopper definition 最短路径算法GH实现.gh (Grasshopper 1.0.8)
# plug-ins: RhinoCodePluginGH

populate_2d = Populate2D(
    Region={Plane=PlaneXY(20.89453415, 19.68591637, 0), Size=Domain2(u=-20.6290141..20.6290141, v=-19.66222908..19.66222908)},
    Count=100,
    Seed=1)
delaunay_edges = DelaunayEdges(Points=populate_2d, Plane=PlaneXY(0, 0, 0))  # -> Connectivity, Edges
_2_net_graph = _2_net_graph(points=populate_2d, topology_connectivity=delaunay_edges.Connectivity)  # -> out, graph; inputs points: list, topology_connectivity: tree
# ---------- _2_net_graph: Python ----------
""" 建立点之间的网络拓扑图.
    ref:Implementing Dijkstra’s Algorithm in Python_https://www.udacity.com/blog/2021/10/implementing-dijkstras-algorithm-in-python.html
    Inputs:
        points: 点列表，需要与topology_connectivity参数字典路径顺序保持一致。DS：List Access;TH：Point3d
        topology_connectivity: 点之间的连通关系，按points参数顺序给出可以连通的点序号。DS：Tree Access;TH：int
        weight:距离权重值列表，default:None。DS：List Access;TH：float
    Output:        
        graph:包含网络图信息的类实例。class instance"""

__author__ = "richiebao caDesign设计(cadesign.cn)"
__version__ = "2022.09.22"

ghenv.Component.Name = '2_net_graph'
ghenv.Component.NickName = '2_net_graph'
ghenv.Component.Description = '建立拓补图，以点之间的距离为节点间的值，可以增加权重'
ghenv.Component.Message = '0.0.1'
ghenv.Component.Category = 'Moths'
ghenv.Component.SubCategory = 'Algorithm N Design'
ghenv.Component.AdditionalHelpFromDocStrings = '1'

import ghpythonlib.components as ghc

class Graph(object):
    ''' 建立网络拓扑图，并建立获取节点（点），节点周边连通点和计算两点间值的方法'''
    def __init__(self, nodes, init_graph):
        self.nodes = nodes
        self.graph = self.construct_graph(nodes, init_graph)
        
    def construct_graph(self, nodes, init_graph):
        '''
        This method makes sure that the graph is symmetrical. In other words, if there's a path from node A to B with a value V, there needs to be a path from node B to node A with a value V.
        '''
        graph = {}
        for node in nodes:
            graph[node] = {}
        
        graph.update(init_graph)
        
        for node, edges in graph.items():
            for adjacent_node, value in edges.items():
                if graph[adjacent_node].get(node, False) == False:
                    graph[adjacent_node][node] = value
                    
        return graph
    
    def get_nodes(self):
        "Returns the nodes of the graph."
        return self.nodes
    
    def get_outgoing_edges(self, node):
        "Returns the neighbors of a node."
        connections = []
        for out_node in self.nodes:
            if self.graph[node].get(out_node, False) != False:
                connections.append(out_node)
        return connections
    
    def value(self, node1, node2):
        "Returns the value of an edge between two nodes."
        return self.graph[node1][node2]
        
def connectivity_distance(pts,connectivity,weight=None):
    '''
    给定点列表、拓扑结构和权重（option）计算网络图

    Parameters
    ----------
    pts : list(Point3d)
        点列表.
    connectivity : Tree(int)
        点之间的连通关系.
    weight : list(float), optional
        距离权重值列表. The default is None.

    Returns
    -------
    graph : Class Instance
        包含网络图信息的类实例.

    '''
    paths=connectivity.Paths
    
    init_graph={}
    nodes=[]
    for i,path in enumerate(paths):
        nodes.append(i)
        init_graph[i]={}
        pt=pts[i]
        pt_connectivity=connectivity.Branch(path)
        #print(pt_connectivity)
        for j in pt_connectivity:
            #print(j)
            pt_neighbor=pts[j]
            distance=ghc.Distance(pt,pt_neighbor)
            if weight:
                distance*=weight[i]
            init_graph[i][j]=distance
    #print(init_graph)
    graph=Graph(nodes,init_graph)
    
    return graph

if __name__=="__main__":
    graph=connectivity_distance(points,topology_connectivity,weight)
    print(topology_connectivity.Paths)
# ---------- end _2_net_graph ----------
_2_net_graph_2 = _2_net_graph(points=populate_2d, topology_connectivity=delaunay_edges.Connectivity)  # -> out, graph; inputs points: list, topology_connectivity: tree
# ---------- _2_net_graph_2: Python ----------
import ghpythonlib.components as ghc

        
def connectivity_distance(pts,connectivity,weight=None):
 
    paths=connectivity.Paths
    
    init_graph={}
    nodes=[]
    for i,path in enumerate(paths):
        nodes.append(i)
        init_graph[i]={}
        pt=pts[i]
        pt_connectivity=connectivity.Branch(path)
        #print(pt_connectivity)
        for j in pt_connectivity:
            #print(j)
            pt_neighbor=pts[j]
            distance=ghc.Distance(pt,pt_neighbor)
            if weight:
                distance*=weight[i]
            init_graph[i][j]=distance
    #print(init_graph)
    return init_graph

if __name__=="__main__":
    graph=connectivity_distance(points,topology_connectivity,weight)
    print(graph)
# ---------- end _2_net_graph_2 ----------
panel = Panel(_2_net_graph_2.out)
panel_2 = Panel(_2_net_graph.out)
panel_3 = Panel(_2_net_graph_2.graph)
panel_4 = Panel(_2_net_graph.graph)
