# Grasshopper definition 树池篦子.gh (Grasshopper 1.0.8)
# plug-ins: RhinoCodePluginGH, Pufferfish, LunchBox

number_slider = Slider(500, range=0..10000)
number_slider_2 = Slider(8, range=0..10)
point = Point(Point(2649.431565, 99.81271466, 0))
unit_y = UnitY(Factor=1)

number_slider_3 = Slider(25, range=0..100)
pi = Pi(Factor=2)
line_sdl = LineSDL(Start=point, Direction=expr("-x", unit_y), Length=Slider(2000, range=0..10000))
division = Division(A=pi, B=number_slider_3)
series = Series(Start=division, Step=division, Count=number_slider_3)
xy_plane = XYPlane(Origin=point)
rotate = Rotate(Geometry=line_sdl, Angle=series, Plane=xy_plane)  # -> Geometry, Transform

addition = Addition(A=number_slider, B=Slider(100, range=0..10000))
python_3_script = Python3Script(x=Slider(325, range=0..10000), y=number_slider, n=Slider(7, range=0..10))  # -> out, edge, mid, dd_singal
# ---------- python_3_script: Python ----------
dd_singal = (y-x)/n
dd_list = []
for i in range(int(n)+1):
    dd_d = x+dd_singal*i
    dd_list.append(dd_d)

edge=[dd_list[0],dd_list[-1]]
mid=[u for u in dd_list if u not in edge]
# ---------- end python_3_script ----------
panel = Panel(python_3_script.dd_singal)
circle = Circle(Plane=point, Radius=python_3_script.edge)
list_item = ListItem(List=circle, Index=expr("-x", 1), Wrap=True)
list_item_2 = ListItem(List=circle, Index=0, Wrap=True)
offset_curve = OffsetCurve(Curve=circle, Distance=number_slider_2, Corners=1)
curve_curve = CurveCurve(CurveA=list_item_2, CurveB=rotate.Geometry)  # -> flatten(Points), ParamsA, ParamsB
curve_curve_2 = CurveCurve(CurveA=list_item, CurveB=rotate.Geometry)  # -> flatten(Points), ParamsA, ParamsB
circle_2 = Circle(Plane=point, Radius=python_3_script.mid)
offset_curve_2 = OffsetCurve(Curve=circle_2, Distance=number_slider_2, Corners=1)
division_2 = Division(A=Slider(8, range=0..10), B=2)
line = Line(StartPoint=curve_curve.Points, EndPoint=curve_curve_2.Points)
offset_curve_3 = OffsetCurve(Curve=line, Plane=PlaneXY(0, 0, 0), Distance=division_2, BothSides=expr("-x", division_2), Kinks=0, CapType=0)
panel_2 = Panel(offset_curve_2)
list_item_3 = ListItem(List=flatten(offset_curve), Index=0, Wrap=True)
curve_curve_3 = CurveCurve(CurveA=offset_curve_2, CurveB=flatten(offset_curve_3))  # -> Points, ParamsA, ParamsB
curve_curve_4 = CurveCurve(CurveA=graft(circle_2), CurveB=flatten(offset_curve_3))  # -> Points, ParamsA, ParamsB
curve_curve_5 = CurveCurve(CurveA=list_item_3, CurveB=offset_curve_3)  # -> Points, ParamsA, flatten(ParamsB)
shift_paths = ShiftPaths(Data=curve_curve_4.ParamsA, Offset="-1")
shift_paths_2 = ShiftPaths(Data=curve_curve_3.ParamsA, Offset="-1")
shatter = Shatter(Curve=flatten(offset_curve_3), Parameters=curve_curve_5.ParamsB)
shatter_2 = Shatter(Curve=offset_curve_2, Parameters=shift_paths_2)  # -> flatten(Segments)
shatter_3 = Shatter(Curve=graft(circle_2), Parameters=shift_paths)  # -> flatten(Segments)
dispatch = Dispatch(List=shatter_2, DispatchPattern=[True, False])  # -> ListA, ListB
dispatch_2 = Dispatch(List=shatter_3, DispatchPattern=[True, False])  # -> ListA, ListB
list_item_4 = ListItem(List=shatter, Index=Slider(1, range=0..1), Wrap=True)
circle_3 = Circle(Plane=point, Radius=addition)
offset_curve_4 = OffsetCurve(Curve=circle_3, Distance=expr("-x", number_slider_2), Corners=1)
data = Data(dispatch.ListB)
data_2 = Data(dispatch_2.ListB)
merge = Merge(Data1=circle, Data2=flatten(offset_curve))  # -> flatten(Result)
merge_2 = Merge(Data1=flatten(circle_3), Data2=flatten(offset_curve_4))
panel_3 = Panel(merge)
merge_3 = Merge(Data1=list_item_4, Data2=data, Data3=data_2)
colour_swatch = ColourSwatch(SwatchColor=RGB(0, 255, 255))
colour_swatch_2 = ColourSwatch(SwatchColor=RGB(0, 255, 255))
colour_swatch_3 = ColourSwatch(SwatchColor=RGB(91, 91, 91))
object_bake = ObjectBake(
    BakeToggle=Button(),
    GeometryObjects=merge_2,
    Layer="L-ROAD-景观轮廓线",
    ObjectName="GH_Obj",
    ObjectColor=colour_swatch,
    LayerColor=colour_swatch)
object_bake_2 = ObjectBake(
    BakeToggle=Button(),
    GeometryObjects=merge,
    Layer="L-ROAD-景观轮廓线",
    ObjectName="GH_Obj",
    ObjectColor=colour_swatch_2,
    LayerColor=colour_swatch_2)
object_bake_3 = ObjectBake(
    BakeToggle=Button(),
    GeometryObjects=merge_3,
    Layer="L-TILE-HATCH１-铺装填充",
    ObjectName="GH_Obj",
    ObjectColor=colour_swatch_3,
    LayerColor=colour_swatch_3)
