# Grasshopper definition 铺装.gh (Grasshopper 1.0.8)
# plug-ins: RhinoCodePluginGH

curve = Curve([<curve referenced from the Rhino model> x2588])
surface = Surface(curve)
list_length = ListLength(List=surface)
number_slider = Slider(0.3, range=0..1)
random = Random(Range=Domain(0, 1), Number=list_length, Seed=2)
larger_than = LargerThan(FirstNumber=random, SecondNumber=number_slider)  # -> LargerThan, OrEqualTo
number_slider_2 = Slider(0.6, range=0..1)
larger_than_2 = LargerThan(FirstNumber=random, SecondNumber=number_slider_2)  # -> LargerThan, OrEqualTo
dispatch = Dispatch(List=surface, DispatchPattern=larger_than.LargerThan)  # -> ListA, ListB
dispatch_2 = Dispatch(List=surface, DispatchPattern=larger_than_2.LargerThan)  # -> ListA, ListB
python_3_script = Python3Script(x=random, a=number_slider, b=number_slider_2)  # -> out, ress; inputs x: list
# ---------- python_3_script: Python ----------
def compare_ab(a,b,x):
    res=[]
    for i in range(len(x)):
        if a<x[i] and b>x[i]:
            res.append(True)
        else:
            res.append(False)
    return res
    

if __name__=='__main__':
    ress=compare_ab(a,b,x)
# ---------- end python_3_script ----------
dispatch_3 = Dispatch(List=surface, DispatchPattern=python_3_script.ress)  # -> ListA, ListB
data = Data(dispatch.ListB)
data_2 = Data(dispatch_2.ListA)
data_3 = Data(dispatch_3.ListA)
custom_preview = CustomPreview(Geometry=data_2, Material=ColourSwatch(SwatchColor=RGB(122, 122, 122)))
custom_preview_2 = CustomPreview(Geometry=data_3, Material=ColourSwatch(SwatchColor=RGB(196, 39, 39)))
custom_preview_3 = CustomPreview(Geometry=data, Material=ColourSwatch(SwatchColor=RGB(0, 0, 0)))
